vi "UDPtest.gvi"   [LabVIEW Communications System Design Suite 2.0.1]
panel controls:
  "TestManConfig in": T1 = {"port"=50000, "ip"="224.5.6.7", "connection"=refnum, "type"=123, "id"=123}
  "stop": bool
panel indicators:
  "status": T2
  "paket": T2
  "command": string
  "switch channel message": T2
  "name of variable": string[]
  "content": string[]
  "channel": string
types:
  T1 = cluster{"port": u16, "ip": string, "connection": UdpNetworkConnectionRefnum, "type": u8, "id": u8}
  T2 = cluster{"type": u8, "id": u8, "name of variable": string[], "content": string[]}
diagram:
  call "UDPopen.gvi"(TestManConfig in=$"TestManConfig in") -> (TestManConfig out=w1, error out=w2)
  s1 = w2  # shift register
  while {
    Wait(time to wait=1)
    call "UDPdecode.gvi"(TestManConfig in=w1, Error in=s1) -> (Error out=w3, TestManConfig out=w4, timestamp out=w5, message out=w6, command out=w7, Packet received=w8)
    case (w8) {
      frame False, Default { }
      frame True {
        case (w7) ignore case {
          frame "" {
            $status <- w6
          }
          frame Default {
            call "UDPreact.gvi"(TestManConfig in=w1, timestamp=w5, received?=FALSE)
            $paket <- w6
            $command <- w7
          }
          frame "switch" {
            Property Node(instance in=w6) -> ("name of variable"=w9, "content"=w10)
            $"name of variable" <- w9
            $content <- w10
            $"switch channel message" <- w6
            Search 1D Array(1D array=w9, element="channel") -> (index of element=w11)
            Array Index(array=w10) -> (out0[w11]=w12)
            $channel <- w12
          }
        }
      }
    }
    Logical Or(w3, $stop) -> w13
    next s1 = w3
    stop if w13
  }
  call "UDPstop.gvi"(TestManConfig=w4, Error=s1)
  $stop <- FALSE
  s2 = w2  # shift register
  while {
    Wait(time to wait=1000)
    Tick Count() -> (timer value=w14)
    Number To Decimal String(number=w14) -> (decimal integer string=w15)
    Initialize Array(element=w15, size=1) -> w16
    w17 = T2 {"type"=0, "id"=0, "name of variable"=["ticks"], "content"=[]}
    Property Node(instance in=w17, "content"=w16) -> (instance out=w18)
    call "UDPsend.gvi"(TestManConfig in=w1, error in=s2, Message=w18) -> (error out=w19)
    Logical Or(w19, $stop) -> w20
    next s2 = w19
    stop if w20
  }
